# Dynamo graph automated_listing_of_documents_in_sheets.dyn (Dynamo 1.3.3.4111)

# group: Note:
# note: For Revit 2016 and below versions, it is recommended to start fresh by closing the program and reopening it again.
# Since, the "Get Linked RVT Documents" node, only reads the initially acquired data (reference links)

# group: Conditions on Dos and Don'ts
# note: Conditions:
# - Always use Dynamo player for 2017 and above versions.
# 1. Same files should not be linked more than once.
# 2. Based on the number of reference documents, plan space accordingly in the Title block.
# 3. Assignment of different reference documents to different Sheets cannot be facilitated, as of now.
# note: Abilities
# 1. Automatically updates Reference documents in all the sheets with the reference to the links attached irrespective of coordinates.
# 2. If any reference links are removed, playing the dynamo player again will update the data in no time.

# group: Pre-Requisites
# note: 1. Install 'Bakery' package.
# 2. Identify the Parameter to be set with Reference document data in Sheets. And then, enter the same name in"Parameter Name in sheets".

parameter_name_in_sheets = CodeBlock { "Reference Documents"; }

# group: Assign Parameter Values to one Single Parameter in all the Sheets.
categories = Categories("Sheets")
all_elements_of_category = ElementsOfCategory(categories)
getParameterValueByName = Element.GetParameterValueByName(element=all_elements_of_category, parameterName=parameter_name_in_sheets)
get_linked_rvt_documents = Custom[Get Linked RVT Documents]()
get_pure_filename_from_revit = Custom[Get Pure Filename from Revit Link Name String](LinkNames=get_linked_rvt_documents.Link_Name)
list_to_single_string = Custom[List to Single String](Original_List=get_pure_filename_from_revit)  # doesn't work with comma strings like sql. renamed fork of "Convert List into List of Strings with Line Breaks"
setParameterByName = Element.SetParameterByName(element=all_elements_of_category, parameterName=parameter_name_in_sheets, value=list_to_single_string)

code_block = CodeBlock { ""; }
